# Grasshopper definition manhattan-cluster-blocks.ghx (Grasshopper 1.0.8)
# plug-ins: atit, RhinoCodePluginGH

file_name = Panel("C:\Users\em4020\Documents\nyc-semantic-bldgs\nyc-semantic-model\nyc_mappluto\MapPLUTO.shp")

# ---- group: Imports Shape Files and Associate Data
file_path_to_gis_data = FilePath(file_name)
toggle = BooleanToggle(True)
imp_it = ImpIt(ShapefileShpPath=file_path_to_gis_data, Project2WGS84=False, TrueOrFalse=toggle)  # -> Shapes, Features
datavis_it = DataVisIt(Shapes=imp_it.Shapes, GetValueofFeature=imp_it.Features, TrueOrFalse=toggle)  # -> Polygon, Polyline, Point, AttValues

# ----
panel = Panel(imp_it.Features)

# ---- group: filter by MN
manhattan = Panel("MN")
borough = Panel("0")
crv_bldg_footprints = Curve(datavis_it.Polygon)
item = ListItem(List=datavis_it.AttValues, Index=borough, Wrap=True)
tmatch = MatchText(Text=item, Pattern=manhattan, Case=True)
cull = CullPattern(List=datavis_it.AttValues, CullPattern=tmatch)
cull_2 = CullPattern(List=crv_bldg_footprints, CullPattern=tmatch)

# ---- group: filter columns
panel_2 = Panel("""0
1
2
3
4
6
7
8
9
10
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""")
cull_i = CullIndex(List=panel, Indices=panel_2, Wrap=True)
cull_i_2 = CullIndex(List=cull, Indices=panel_2, Wrap=True)

# ----
geo_manhattan_footprints = Geometry(cull_2)
data_building_features = Data(cull_i_2)
data_feature_names = Data(cull_i)

# ---- group: average features by block id
py3_group_features = Python3Script(x=data_building_features)  # -> out, a; inputs x: tree
# ---------- py3_group_features: Python ----------
"""
GHPython Script
Inputs:
    x: Data Tree (one branch per record, index 0 = ID, index 1..23 = values)
Outputs:
    out_tree: Data Tree grouped by ID, with averages of values 1..23
"""

from Grasshopper import DataTree
from Grasshopper.Kernel.Data import GH_Path
import System

print('hello world')

# Convert tree to Python list
data = []
for path in x.Paths:
    branch = list(x.Branch(path))
    data.append(branch)

# Group by ID
groups = {}
for branch in data:
    id_val = branch[0]
    # print(id_val)
    # convert to float where possible, else 0
    values = []
    for v in branch[1:]:
        try:
            values.append(float(v))
        except:
            values.append(0.0)
    if id_val not in groups:
        groups[id_val] = []
    groups[id_val].append(values)

print("made groups")

# Compute averages for each ID
averages = {}
for id_val, vals_list in groups.items():
    # transpose to get columns
    cols = zip(*vals_list)
    avg_row = [sum(col) / len(col) for col in cols]
    averages[id_val] = avg_row

print("got averages")

# Build output tree
out_tree = DataTree[object]()
for i, (id_val, avg_row) in enumerate(averages.items()):
    new_path = GH_Path(i)
    out_tree.Add(id_val, new_path)  # ID in index 0
    for val in avg_row:
        out_tree.Add(val, new_path)  # Averages in indices 1..n

print("made output tree")

a = out_tree
# ---------- end py3_group_features ----------

# ---- group: extrude and cap footprints
geo_manhattan_footprints_2 = Geometry(geo_manhattan_footprints)
n_floors = Panel("14")
item_2 = ListItem(List=data_building_features, Index=n_floors, Wrap=True)
floor_height = Panel("14")
multiplication = Multiplication(A=item_2, B=floor_height)
Z = UnitZ(Factor=multiplication)
extr = Extrude(Base=geo_manhattan_footprints_2, Direction=Z)
cap = CapHoles(Brep=extr)

# ----
bctcb2020 = Panel("0")
number_slider = Slider(10, range=0..16)
item_3 = ListItem(List=data_building_features, Index=bctcb2020, Wrap=True)  # -> flatten(Item)
item_4 = ListItem(List=py3_group_features.a, Index=0, Wrap=True)  # -> flatten(Item)

# ---- group: run k means to cluster block ids
py3_kmeans_cluster = Python3Script(data=py3_group_features.a, n_clusters=number_slider)  # -> out, flatten(clusters); inputs data: tree, n_clusters: Int32
# ---------- py3_kmeans_cluster: Python ----------
import random
import math
from Grasshopper import DataTree
from collections import Counter

print('n clusters: ' + str(n_clusters))
print('num data points: ' + str(data.BranchCount))

# Extract features from the data tree into separate lists
lot_a = []
bldg_a = []
com_a = []
res_a = []
office_a = []
retail_a = []
n_buildings = []
n_floors = []
unit_res = []
unit_total = []
year_built = []
built_far = []
res_far = []
com_far = []
area = []

for path in data.Paths:
    branch = data.Branch(path)
    lot_a.append(float(branch[2]))
    bldg_a.append(float(branch[3]))
    com_a.append(float(branch[4]))
    res_a.append(float(branch[5]))
    office_a.append(float(branch[6]))
    retail_a.append(float(branch[7]))
    n_buildings.append(float(branch[13]))
    n_floors.append(float(branch[14]))
    unit_res.append(float(branch[15]))
    unit_total.append(float(branch[16]))
    year_built.append(float(branch[17]))
    built_far.append(float(branch[18]))
    res_far.append(float(branch[19]))
    com_far.append(float(branch[20]))
    area.append(float(branch[21]))

def normalize(lst):
    min_val = min(lst)
    max_val = max(lst)
    if max_val == min_val:
        return [0.0] * len(lst)
    return [(x - min_val) / (max_val - min_val) for x in lst]

# Normalize each feature list
lot_a = normalize(lot_a)
bldg_a = normalize(bldg_a)
com_a = normalize(com_a)
res_a = normalize(res_a)
office_a = normalize(office_a)
retail_a = normalize(retail_a)
n_buildings = normalize(n_buildings)
n_floors = normalize(n_floors)
unit_res = normalize(unit_res)
unit_total = normalize(unit_total)
year_built = normalize(year_built)
built_far = normalize(built_far)
res_far = normalize(res_far)
com_far = normalize(com_far)
area = normalize(area)

# Pack features into vectors
data = list(zip(lot_a, bldg_a, com_a, res_a, office_a, retail_a, n_buildings, n_floors, unit_res, unit_total, year_built, built_far, res_far, com_far, area))

# Initialize k random centroids
random.seed(42)
centroids = random.sample(data, n_clusters)

def distance(a, b):
    return math.sqrt(sum((ai - bi)**2 for ai, bi in zip(a, b)))

def mean(points):
    n = len(points)
    if n == 0: 
        return [0]*len(points[0])
    return [sum(p[i] for p in points)/n for i in range(len(points[0]))]

i = 10
for _ in range(i):
    clusters = [[] for _ in range(n_clusters)]
    labels = []
    for point in data:
        dists = [distance(point, c) for c in centroids]
        label = dists.index(min(dists))
        clusters[label].append(point)
        labels.append(label)
    centroids = [mean(c) for c in clusters]

# Output cluster labels
clusters = labels
print('len(labels): ' + str(len(labels)))

counts = Counter(clusters)
print(counts)
# ---------- end py3_kmeans_cluster ----------

# ----
data_unique_block_ids = Data(item_4)
data_block_ids = Data(item_3)

# ---- group: map grafted building data --> cluster
py3_map_block_ids = Python3Script(m_block_id=data_unique_block_ids, m_cluster=py3_kmeans_cluster.clusters, block_ids_to_map=data_block_ids)  # -> out, mapped_clusters; inputs m_block_id: list, m_cluster: list, block_ids_to_map: list
# ---------- py3_map_block_ids: Python ----------
# Inputs:
# block_ids: unique block IDs list (length 3232)
# clusters: cluster label per block (length 3232)
# building_block_ids: list of block IDs per building (same order as footprints)

# Create a lookup dict from block ID to cluster
block_ids_to_map = [str(bid) for bid in block_ids_to_map]
m_block_id = [str(bid) for bid in m_block_id]

# Create lookup dict
blockid_to_cluster = dict(zip(m_block_id, m_cluster))

# Map once, no extra checks or prints
mapped_clusters = [blockid_to_cluster.get(bid, -1) for bid in block_ids_to_map]

print(f"Mapped {len(mapped_clusters)} clusters")
# ---------- end py3_map_block_ids ----------

# ----
dom = ConstructDomain(DomainStart=0, DomainEnd=number_slider)
remap = RemapNumbers(Value=py3_map_block_ids.mapped_clusters, Source=dom, Target=Domain(0, 1))  # -> Mapped, Clipped
gradient = Gradient(
    LowerLimit=0,
    UpperLimit=1,
    Parameter=remap.Mapped,
    stops=[0: RGB(234, 38, 0), 0.173: RGB(234, 126, 0), 0.5: RGB(254, 244, 84), 0.66: RGB(173, 203, 249), 0.951: RGB(75, 107, 169)])
geo_buildings = Geometry(cap)
data = Data(graft(gradient))
path_mapper = PathMapper(data, source="{A;B}", target="{B;A}")
preview = CustomPreview(Geometry=geo_buildings, Material=path_mapper)
